% Simulink data dictionary QuadData.sldd

ts_comms = 0.1
ts_uav = 0.01
UAVmass = 0.05
g = 9.81

MultirotorGuidanceControlBus = Simulink.Bus()
  Roll: double
  Pitch: double
  YawRate: double
  Thrust: double

MultirotorGuidanceEnvironmentBus = Simulink.Bus()
  Gravity: double

MultirotorGuidanceStateBus = Simulink.Bus()
  WorldPosition: double[3 1]
  WorldVelocity: double[3 1]
  EulerZYX: double[3 1]
  BodyAngularRateRPY: double[3 1]
  Thrust: double

Cmds = Simulink.Bus()
  Takeoff: boolean
  Land: boolean
  EmergencyOff: boolean

CrashCmd = 3

Telemetry = Simulink.Bus()
  MAVMsg: uint8[1 21]
  CustomMsg: uint8[3]

GCSCmds = Simulink.Bus()
  MAVMsg: uint8[1 18]
  CustomMsg: uint8[3]

spoofTime = 7
quad_config = Simulink.ConfigSet(StartTime="0", StopTime="15", RelTol="1e-3", Solver="VariableStepAuto", ProdHWDeviceType="Intel->x86-64 (Windows64)", SystemTargetFile="grt.tlc", TargetLang="C")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

GuidanceRelPosBus = Simulink.Bus()
  RelPosX: double
  RelPosY: double
  RelPosZ: double

FaultFlagsBus = Simulink.Bus()
  ThrustAnomaly: boolean
  ModeAnomaly: boolean
  PositionAnomaly: boolean
  AnyFault: boolean

MAVLink_Comms = Simulink.VariantExpression(Condition="varComms == 1")
Custom_Comms = Simulink.VariantExpression(Condition="varComms == 0")
No_Threat = Simulink.VariantExpression(Condition="varThreat == 0")
Active_Threat = Simulink.VariantExpression(Condition="varThreat == 1")
landTime = 80
varComms = 1
varThreat = 0
waypoints = [0 0 -1; 0 2 -1; 2 2 -1; 2 0 -1; 1 1 -1.5]