% Simulink data dictionary QuadData.sldd

ts_comms = 0.1
ts_uav = 0.01
UAVmass = 0.05
g = 9.81

MultirotorGuidanceControlBus = Simulink.Bus()
  Roll: double
  Pitch: double
  YawRate: double
  Thrust: double

MultirotorGuidanceEnvironmentBus = Simulink.Bus()
  Gravity: double

MultirotorGuidanceStateBus = Simulink.Bus()
  WorldPosition: double[3 1]
  WorldVelocity: double[3 1]
  EulerZYX: double[3 1]
  BodyAngularRateRPY: double[3 1]
  Thrust: double

quad_config = Simulink.ConfigSet(StartTime="0", StopTime="30", RelTol="1e-3", Solver="VariableStepAuto", ProdHWDeviceType="Intel->x86-64 (Windows64)", SystemTargetFile="grt.tlc", TargetLang="C")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

OperatorCmds = Simulink.Bus()
  Takeoff: boolean
  Land: boolean
  EmergencyOff: boolean

waypoints = [0 0 -1
 0 1 -1
 1 1 -1
 1 0 -1
 2 0 -1
 2 1 -1
 3 1 -1
 3 0 -1
 4 0 -1
 4 1 -1
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 ]

landTime = 27