# Requirement set SystemRequirements (R2026a)

## 1 [#1] Communications Capability
The system shall provide communication capabilities to coordinate with launch platform to support search and rescue efforts during missions

## 2 [#2] Imaging Capability (Container)
The system shall perform various imaging capabilities for search and rescue

### 2.1 [#3] Image Capture
The UAV shall include a payload sensor capable of capturing images in the visible light spectrum.

### 2.2 [#4] Image Processing
The UAV shall have image-processing capabilities to support identifying locations of interest and distinguishing lost personnel for search and rescue mission.

### 2.3 [#5] Imagery Intelligence
The UAV shall have imagery intelligence capabilities to support imagery mapping and seeking capabilities.

## 3 [#6] UAV Capability (Container)
The system shall provide UAV capability that will support search and rescue missions

### 3.1 [#7] UAV Autonomous Flying
The system shall be able to follow a flight path even if it loses connection with Ground Control Station

### 3.2 [#8] UAV Hover Capabilities
The system shall maintain position, hover over an area of interest

### 3.3 [#9] UAV Operation Period
The system shall conduct a maximum of 30 minutes of operations for search and rescue missions without recharging.

### 3.4 [#10] UAV Fly Patterns
The system shall fly a predetermined pattern in order to conduct search and rescue reconnaissance with either IR sensors or full motion video

## 4 [#11] Aircraft Performance (Container)

### 4.1 [#12] Cruise Speed
The UAV cruise speed shall be at least 30 knots

### 4.2 [#13] Max Speed
The UAV shall have a max speed of 45 knots

### 4.3 [#14] UAV Operation Period
The UAV shall have minimum endurance of 15 minutes loiter at 0.5 m radius

### 4.4 [#15] Operational Radius
The UAV shall have an operational radius of 0.5 m while sustaining cruise speed and hovering 5 minutes at the turn around point.

### 4.5 [#16] Recovery Condition
The UAV shall be able to be recovered with at least 30% remaining battery capacity.

### 4.6 [#17] Operational Altitude
The UAV shall be able to fly at an altitude of at least 500 ft. while maintaining minimum maneuverability requirements.

## 5 [#18] Power System (Container)

### 5.1 [#19] Power Source
The aircraft battery shall power all aircraft and payload components.

### 5.2 [#20] Sizing
The battery shall support a minimum of 15 minutes of flight during normal UAV operation.

## 6 [#21] Mass Properties & Geometry (Container)

### 6.1 [#22] Total volume
The aircraft with attached payload shall fit inside a 56cm x 36cm x 23cm container.

### 6.2 [#23] Total Mass
The aircraft and payload total mass shall be <= 5 kg.

## 7 [#24] Flight Control System (Container)

### 7.1 [#25] FCS communications (Container)
The FCS shall send data to and receive data from the Ground Control Station to support safe UAV operation.

#### 7.1.1 [#26] FCS receive commands
The FCS shall recieve commands from the Ground Control Station.

#### 7.1.2 [#27] FCS send telemetry
The FCS shall send telemetry data to the Ground Control Station.

### 7.2 [#28] FCS Modes
The FCS shall allow the aircraft to autonomously takeoff, land, and track waypoints or an identified target with necessary safety modes for off-nominal situations.

### 7.3 [#29] FCS Target Tracking
The FCS shall receive target position data from the launch platform, combine this with onboard sensor data, and calculate an estimated position of the target relative to the quadcopter.

### 7.4 [#30] FCS Control
The FCS shall enable autonomous stable flight with sufficient maneuverability to track waypoints or an identified target.