# Requirement set conops (R2026a)

## 1 [#36] Surveillance Capability
The system shall provide surveillance capabilities to support search and rescue missions

### 1.1 [#37] Human Search and Rescue with UAV
The system shall use UAV to locate people during search and rescue missions with use of payloads, full motion video.

## 2 [#38] Communications Capability
The system shall provide communication capabilities to coordinate with launch platform to support search and rescue efforts during missions.

## 3 [#39] Imaging Capability
The system shall perform various imaging capabilities for search and rescue

### 3.1 [#40] Image Capture
The UAV shall include a payload sensor capable of capturing images in the visible light spectrum.

### 3.2 [#41] Image Processing
The UAV shall have image-processing capabilities to support identifying locations of interest and distinguishing lost personnel for search and rescue mission.

### 3.3 [#42] Imagery Intelligence
The UAV shall have imagery intelligence capabilities to support imagery mapping and seeking capabilities.

## 4 [#43] UAV Capability (Container)
The system shall provide UAV capability that will support search and rescue missions

### 4.1 [#44] UAV Autonomous Launch and Recover
The system shall provide UAV to have autonomous shipboard launch and recover with little or no human interfacing.

#### 4.1.1 [#45] UAV Launch and Landing Areas
The system shall able to launch and land off of a Coast Guard 35-foot long range interceptor II cutter boat.

#### 4.1.2 [#46] UAV Launch and Recover in High Sea States
The system shall to be able to Launch and Recover in sea states five without causing damage to the UAV, ship or crew.

### 4.2 [#47] UAV Autonomous Flying
The system shall be able to follow a flight path even if it loses connection with ship’s ground control station.

### 4.3 [#48] UAV Hover Capabilities
The system shall maintain position, hover over an area of interest.

### 4.4 [#49] UAV Operation Period
The system shall conduct a maximum of 30 minutes of operations for search and rescue missions without recharging.

### 4.5 [#50] UAV Fly Patterns
The system shall fly a predetermined pattern in order to conduct search and rescue reconnaissance with either IR sensors or full motion video.

## 5 [#51] Justifications (Justification)

### 5.1 [#52] Verified by inspection (Justification)