# Requirement set gcs (R2026a)

## 1 [#1] Operator Interface (Container)

### 1.1 [#2] Operator Commands
The GCS shall provide capability for an operator to send commands to the vehicle.

### 1.2 [#3] Operator Situational Awareness
The operator shall receive sufficient telemetry data from the vehicle to correctly determine the safety, security, and effectiveness of the system.