# Requirement set uav (R2026a)

## 1 [#1] Aircraft Performance (Container)

### 1.1 [#2] Cruise Speed
The UAV cruise speed shall be at least 30 knots.

### 1.2 [#3] Max Speed
The UAV shall have a max speed of 45 knots.

### 1.3 [#4] UAV Operation Period
The UAV shall have minimum endurance of 15 minutes loiter at 0.5 m radius.

### 1.4 [#5] Operational Radius
The UAV shall have an operational radius of 0.5 m while sustaining cruise speed and hovering 5 minutes at the turn around point.

### 1.5 [#6] Recovery Condition
The UAV shall be able to be recovered with at least 30% remaining battery capacity.

### 1.6 [#7] Operational Altitude
The UAV shall be able to fly at an altitude of at least 500 ft. while maintaining minimum maneuverability requirements.

## 2 [#8] Power System (Container)

### 2.1 [#9] Power Source
The aircraft battery shall power all aircraft and payload components.

### 2.2 [#10] Sizing
The battery shall support a minimum of 15 minutes of flight during normal UAV operation.

## 3 [#11] Mass Properties & Geometry (Container)

### 3.1 [#12] Total volume
The aircraft with attached payload shall fit inside a 56cm x 36cm x 23cm container.

### 3.2 [#13] Total Mass
The aircraft and payload total mass shall be <= 5 kg.

## 4 [#14] Flight Control System (Container)

### 4.1 [#15] FCS communications (Container)
The FCS shall send data to and receive data from the Ground Control Station to support safe UAV operation.

#### 4.1.1 [#25] FCS receive commands
The FCS shall recieve commands from the Ground Control Station.

#### 4.1.2 [#26] FCS send telemetry
The FCS shall send telemetry data to the Ground Control Station.

### 4.2 [#16] FCS Modes
The FCS shall allow the aircraft to autonomously takeoff, land, and track waypoints or an identified target with necessary safety modes for off-nominal situations.

### 4.3 [#17] FCS Target Tracking
The FCS shall receive target position data from the launch platform, combine this with onboard sensor data, and calculate an estimated position of the target relative to the quadcopter.

### 4.4 [#18] FCS Control
The FCS shall enable autonomous stable flight with sufficient maneuverability to track waypoints or an identified target.

## 5 [#19] Payload (Container)

### 5.1 [#20] Power source
The payload shall draw power from the aircraft battery

#### 5.1.1 [#21] Power switch
The payload sensor shall be able to be powered on/off independently from the aircraft

### 5.2 [#22] Payload sensor
The payload sensor shall be a visible light spectrum camera

### 5.3 [#23] Max Payload Weight
The mission payload shall be not less than 200 lbs total in four individually deployable segments 50 lb or more.
Rationale: Suspected copy-paste error — inconsistent with uav #13 (total mass <= 5 kg). Requires authoring correction.
Keywords: REVIEW

## 6 [#24] Image Processing
UAV can detect down personnel