% Requirement links of variant_comms.slreqx (R2026a)

#1 relates to QuadArchitecture.slx#80: GroundControlStation
#1 relates to QuadArchitecture.slx#131: CommsIn
#1 relates to QuadArchitecture.slx#80: GroundControlStation
#1 relates to QuadArchitecture.slx#80: GroundControlStation
#1 relates to QuadArchitecture.slx#131: CommsIn
#2 relates to QuadArchitecture.slx#80: GroundControlStation
#2 relates to QuadArchitecture.slx#131: CommsIn
#2 relates to QuadArchitecture.slx#80: GroundControlStation
#2 relates to QuadArchitecture.slx#131: CommsIn
#3 relates to QuadArchitecture.slx#95: Threat
#3 relates to QuadArchitecture.slx#95: Threat